# Grasshopper definition 00_geo.ghx (Grasshopper 1.0.8)

# Design
point = Point([<point referenced from the Rhino model> x7])
curve = Curve([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])
line = Line(curve)
widths = Number([0.05, 0.05, 0.05, 0.05, 0.05, 0.05, 0.05, 0.05, 0.05, 0.05, 0.05, 0.05, 0.05, 0.05])
point_2 = Point(point)
point_list = PointList(Points=point_2, Size=Slider(0.1, range=0..1))
heights = Number([0.06, 0.06, 0.06, 0.06, 0.06, 0.06, 0.06, 0.06, 0.06, 0.06, 0.06, 0.06, 0.06, 0.06])
# Convert to Truss
python_3_script = Python3Script(points=point_2, lines=line, widths=widths, heights=heights)  # -> out, cut_rectangles, rectangles, truss, beams, beam_ids, points, nodes; inputs points: list of Point3d, lines: list of Line, widths: list of Double, heights: list of Double
# ---------- python_3_script: Python ----------
import os
import sys
import importlib
HERE = ghdoc.Path
path =  os.path.abspath(os.path.join(HERE, '..', '..', 'python'))

if path not in sys.path:
    sys.path.append(path)

if "geometry" in sys.modules:
    importlib.reload(sys.modules["geometry"])

from geometry import Truss, Beam, Node

#make truss
truss = Truss()

for p in points:
    truss.add_node(p)

for l,h,w in zip(lines, heights, widths):
    truss.add_beam(l,h,w)

beams = truss.beams
nodes = truss.nodes

beam_ids = [b.id for b in truss.beams]
points = [b.centroid for b in truss.beams]

#get cut geometry

truss.cut_all_beams()

cut_rectangles = [b.cut_polyline for b in truss.beams]
rectangles = [b.uncut_polyline for b in truss.beams]
# ---------- end python_3_script ----------
# Export
python_3_script_2 = Python3Script(truss=python_3_script.truss, export=Toggle(True), file_name="truss")  # -> out, cut_rectangles, rectangles, truss; inputs file_name: String
# ---------- python_3_script_2: Python ----------
import os
import sys
import importlib
HERE = ghdoc.Path
path =  os.path.abspath(os.path.join(HERE, '..', '..', 'python'))

if path not in sys.path:
    sys.path.append(path)

if "geometry" in sys.modules:
    importlib.reload(sys.modules["geometry"])

JSON = os.path.abspath(os.path.join(HERE, '..', '..', 'json'))
file_path = JSON + "/" + file_name + ".json"

if path not in sys.path:
    sys.path.append(path)

if export:
    truss.to_json(file_path)
# ---------- end python_3_script_2 ----------
geometry = Geometry(python_3_script.cut_rectangles)
curve_2 = Curve(python_3_script.rectangles)
# place 0,1 and change width of 2
python_3_script_3 = Python3Script(truss=python_3_script_2.truss, export=Toggle(True), file_name="truss_01")  # -> out, cut_rectangles, rectangles, truss; inputs file_name: String
# ---------- python_3_script_3: Python ----------
import os
import sys
import importlib
HERE = ghdoc.Path
path =  os.path.abspath(os.path.join(HERE, '..', '..', 'python'))

if path not in sys.path:
    sys.path.append(path)

if "geometry" in sys.modules:
    importlib.reload(sys.modules["geometry"])

JSON = os.path.abspath(os.path.join(HERE, '..', '..', 'json'))
file_path = JSON + "/" + file_name + ".json"

print(truss.beams[2].width)

#beams 0, 1 have been placed
truss.beams[0].fabricated = True
truss.beams[1].fabricated = True
truss.beams[3].width = 0.09


if export:
    truss.to_json(file_path)
# ---------- end python_3_script_3 ----------
# Import
python_3_script_4 = Python3Script(read=Toggle(True), file_name="truss_01")  # -> out, truss, nodes, beams, cut_rectangles; inputs read: Boolean, file_name: String
# ---------- python_3_script_4: Python ----------
import os
import sys
import importlib
HERE = ghdoc.Path
path =  os.path.abspath(os.path.join(HERE, '..', '..', 'python'))

if path not in sys.path:
    sys.path.append(path)

if "geometry" in sys.modules:
    importlib.reload(sys.modules["geometry"])

JSON = os.path.abspath(os.path.join(HERE, '..', '..', 'json'))
file_path = JSON + "/" + file_name + ".json"

from geometry import Truss

if read:
    truss = Truss.from_json(file_path)
    nodes = truss.nodes
    beams = truss.beams
    for beam in beams:
        print(beam.width, beam.reference_width)
    
    truss.cut_all_beams()
    cut_rectangles = [b.cut_polyline for b in truss.beams]
# ---------- end python_3_script_4 ----------
custom_preview = CustomPreview(Geometry=geometry, Material=ColourSwatch(SwatchColor=RGB(255, 0, 0)))
curve_3 = Curve([<curve referenced from the Rhino model> x4])
panel = Panel(python_3_script.out)
curve_4 = Curve(python_3_script_4.cut_rectangles)
line_2 = Line(curve_3)
text_tag = TextTag(Location=python_3_script.points, Text=python_3_script.beam_ids, Colour=ColourSwatch(SwatchColor=RGB(255, 255, 255)))
point_3 = Point(<point referenced from the Rhino model>)
custom_preview_2 = CustomPreview(Geometry=python_3_script_4.cut_rectangles, Material=ColourSwatch(SwatchColor=RGB(0, 255, 85)))
mesh = Mesh(python_3_script_4.cut_rectangles)
panel_2 = Panel(python_3_script_4.truss)
python_3_script_5 = Python3Script(truss=python_3_script_4.truss, export=Toggle(True), file_name="truss_02", new_node=point_3, new_axis=line_2)  # -> out, cut_rectangles, rectangles, truss, nodes; inputs file_name: String, new_node: Point3d, new_axis: list of Line
# ---------- python_3_script_5: Python ----------
import os
import sys
import importlib
HERE = ghdoc.Path
path =  os.path.abspath(os.path.join(HERE, '..', '..', 'python'))

if path not in sys.path:
    sys.path.append(path)

if "geometry" in sys.modules:
    importlib.reload(sys.modules["geometry"])

JSON = os.path.abspath(os.path.join(HERE, '..', '..', 'json'))
file_path = JSON + "/" + file_name + ".json"

print(truss.beams[2].width)
print(len(truss.nodes))

#beams 0, 1 have been placed
truss.beams[3].fabricated = True
truss.add_node(new_node)
nodes = truss.nodes
for axis in new_axis:
    truss.add_beam(axis, 0.05, 0.06, True, False)


if export:
    truss.to_json(file_path)
# ---------- end python_3_script_5 ----------
geometry_2 = Geometry(geometry)
explode = Explode(Curve=geometry_2, Recursive=True)  # -> Segments, Vertices
python_3_script_6 = Python3Script(read=Toggle(True), file_name="truss_02")  # -> out, truss, nodes, beams, cut_rectangles, beam_ids, points; inputs read: Boolean, file_name: String
# ---------- python_3_script_6: Python ----------
import os
import sys
import importlib
HERE = ghdoc.Path
path =  os.path.abspath(os.path.join(HERE, '..', '..', 'python'))

if path not in sys.path:
    sys.path.append(path)

if "geometry" in sys.modules:
    importlib.reload(sys.modules["geometry"])

JSON = os.path.abspath(os.path.join(HERE, '..', '..', 'json'))
file_path = JSON + "/" + file_name + ".json"

from geometry import Truss

if read:
    truss = Truss.from_json(file_path)
    nodes = truss.nodes
    beams = truss.beams
    for beam in beams:
        print(beam.width, beam.reference_width)

    beam_ids = [b.id for b in truss.beams]
    points = [b.centroid for b in truss.beams]

    #truss.cut_all_beams()
    #cut_rectangles = [b.cut_polyline for b in truss.beams]
# ---------- end python_3_script_6 ----------
panel_3 = Panel(python_3_script.beams)
panel_4 = Panel(explode.Vertices)
panel_5 = Panel(python_3_script.nodes)
text_tag_2 = TextTag(Location=python_3_script_6.points, Text=python_3_script_6.beam_ids, Colour=ColourSwatch(SwatchColor=RGB(255, 255, 255)))
panel_6 = Panel(python_3_script_6.beams)
panel_7 = Panel(python_3_script_6.nodes)
